# Dynamo graph StealthyRoofscapes_CreateContextfromOSM.dyn (Dynamo 2.0.2.6826)

# group: Select OSM File
file_path = Filename(".\map.osm")

# group: Elk
# note: Custom Node: Elk v.1.1.0
location = Elk.OSM.Location(filePath=file_path)
features = Elk.OSM.Features()

code_block = CodeBlock(x=features) { x[5]; }
code_block_2 = CodeBlock { 10; }

# group: Elk
# note: Custom Node: Elk v.1.1.0
subFeatures = Elk.OSM.SubFeatures(feature=code_block, subIndexes=code_block_2)
OSMData = Elk.OSM.OSMData(OSM=location.OSM, File=location.XML, featureType=code_block, subTypes=subFeatures.all)

# group: Polygons for Building Footprints
byPoints = Polygon.ByPoints(points=OSMData.Points)
boolean = BoolSelector(false)
clean = List.Clean(list=byPoints, preserveIndices=boolean)
flatten = List.Flatten(list=clean)

ZAxis = Vector.ZAxis()

# group: Bounds for Building Heights
lowest_height = DoubleSlider(10, range=0..100 step 0.1)
highest_height = DoubleSlider(30, range=0..100 step 0.1)

# group: Generate Random Building Heights
count = List.Count(list=flatten)
# note: Should be replaced with proper survey data
code_block_3 = CodeBlock(low=lowest_height, high=highest_height, c=count) { low..high..#c; }
shuffle = List.Shuffle(list=code_block_3)

# group: Building Solids
extrudeAsSolid = Curve.ExtrudeAsSolid(curve=flatten, direction=ZAxis, distance=shuffle)

# group: Select Building
code_block_4 = CodeBlock(x=extrudeAsSolid) { x[36]; }

# group: Get Roof Surface
faces = Topology.Faces(topology=code_block_4)
surfaceGeometry = Face.SurfaceGeometry(face=faces)
code_block_5 = CodeBlock { 0.5; }
normalAtParameter = Surface.NormalAtParameter(surface=surfaceGeometry, u=code_block_5, v=code_block_5)
ZAxis_2 = Vector.ZAxis()
angleWithVector = Vector.AngleWithVector(vector=normalAtParameter, otherVector=ZAxis_2)
code_block_6 = CodeBlock { 0; }
eq = angleWithVector == code_block_6
filterByBoolMask = List.FilterByBoolMask(list=surfaceGeometry, mask=eq)
code_block_7 = CodeBlock(x=filterByBoolMask.in) { x[0]; }

roof = Watch(code_block_7)

# group: Filepaths
file_path_2 = Filename(".\1-roof")
file_path_3 = Filename(".\1-points")
file_path_4 = Filename(".\1-buildings.sat")
file_path_5 = Filename(".\1-ground")

# group: Points for Ground Plane Points
clean_2 = List.Clean(list=OSMData.Points, preserveIndices=boolean)
flatten_2 = List.Flatten(list=clean_2)
byGeometry = BoundingBox.ByGeometry(geom=flatten_2)
minPoint = BoundingBox.MinPoint(boundingBox=byGeometry)
maxPoint = BoundingBox.MaxPoint(boundingBox=byGeometry)
code_block_8 = CodeBlock(p1=minPoint, p2=maxPoint)
# ---------- code_block_8.designscript (5 lines) ----------
o1 = Point.ByCoordinates(p1.X,p1.Y);
o2 = Point.ByCoordinates(p1.X,p2.Y);
o3 = Point.ByCoordinates(p2.X,p2.Y);
o4 = Point.ByCoordinates(p2.X,p1.Y);
[o1,o2,o3,o4];
# ----------------------------------------

# group: Ground Plane
byPoints_2 = Polygon.ByPoints(points=code_block_8.out4)
byPatch = Surface.ByPatch(closedCurve=byPoints_2)

# group: Viewpoints
code_block_9 = CodeBlock { 0..1..#10; }
pointAtParameter = Surface.PointAtParameter(surface=byPatch, u=code_block_9, v=code_block_9, lacing=CrossProduct)
flatten_3 = List.Flatten(list=pointAtParameter)

center = Polygon.Center(polygon=byPoints_2)

# group: Max Viewpoint Distance
code_block_10 = CodeBlock { 150; }

# group: Filter out far Points beyond Max Viewpoint Distance
distanceTo = Geometry.DistanceTo(geometry=flatten_3, other=center)
code_block_11 = CodeBlock(d=distanceTo, l=code_block_10) { d > l; }
filterByBoolMask_2 = List.FilterByBoolMask(list=flatten_3, mask=code_block_11)

# group: Python to check whether points intersect with a context building and therefore can be disregarded
python_script = Python(IN[0]=filterByBoolMask_2.out, IN[1]=extrudeAsSolid)
# ---------- python_script.python (22 lines) ----------
# Enable Python support and load DesignScript library
import clr
clr.AddReference('ProtoGeometry')
from Autodesk.DesignScript.Geometry import *

# The inputs to this node will be stored as a list in the IN variables.
points = IN[0]
solids = IN[1]

bools = []
for pt in points:
	bool = False
	#bools.append(Geometry.DoesIntersect(pt, solids[0]))
	for sol in solids:
		bool = Geometry.DoesIntersect(pt, sol)
		if bool:
			break
	bools.append(bool)
			

# Assign your output to the OUT variable.
OUT = bools
# ----------------------------------------

# group: Retained Viewpoints
filterByBoolMask_3 = List.FilterByBoolMask(list=filterByBoolMask_2.out, mask=python_script)
code_block_12 = CodeBlock(x=filterByBoolMask_3.out) { x; }

points = Watch(code_block_12)
buildings = Watch(extrudeAsSolid)
ground_plane = Watch(byPatch)

# group: Export to SAT
exportToSAT = Geometry.ExportToSAT(geometry=roof, filePath=file_path_2)  # frozen
exportToSAT_2 = Geometry.ExportToSAT(geometry=points, filePath=file_path_3)  # frozen
exportToSAT_3 = Geometry.ExportToSAT(geometry=buildings, filePath=file_path_4)  # frozen
exportToSAT_4 = Geometry.ExportToSAT(geometry=ground_plane, filePath=file_path_5)  # frozen
