# Dynamo graph StealthyRoofscapes_CreateForm.dyn (Dynamo 2.0.2.6826)

# group: Select SAT Files
ground_surface = Filename("C:\Users\thomas.corrie\Box Sync\Dynamo Hackathon 2019\1-ground.sat")  # frozen
roof_surface = Filename("C:\Users\thomas.corrie\Box Sync\Dynamo Hackathon 2019\1-roof.sat")
viewpoints = Filename("C:\Users\thomas.corrie\Box Sync\Dynamo Hackathon 2019\1-points.sat")
buildings = Filename("C:\Users\thomas.corrie\Box Sync\Dynamo Hackathon 2019\1-buildings.sat")

# group: SAT Imports
ground_surface_2 = Geometry.ImportFromSAT(filePath=ground_surface)
roof_surface_2 = Geometry.ImportFromSAT(filePath=roof_surface)
viewpoints_2 = Geometry.ImportFromSAT(filePath=viewpoints)
buildings_2 = Geometry.ImportFromSAT(filePath=buildings)

# group: Point at Centroid of Roof
code_block = CodeBlock { 0.5; }
# note: Centroid is to untrimmed surface and so may not be necessarily the geometric centre of the roof
pointAtParameter = Surface.PointAtParameter(surface=roof_surface_2, u=code_block, v=code_block)

# group: Roof Form Variables
XOffset = DoubleSlider(-25.74982571, range=-31..31 step 0.5)  # graph input
# note: See ranges left for XOffset and YOffset to avoid failure of geometry
YOffset = DoubleSlider(-11.5, range=-24..24 step 0.5)  # graph input
rotation = DoubleSlider(87.20977007, range=0..180 step 1)  # graph input
length = DoubleSlider(72.68378603, range=0.5..100 step 0.5)  # graph input
width = DoubleSlider(98.55806887, range=0.5..100 step 0.5)  # graph input
height = DoubleSlider(10.10065131, range=4..30 step 0.5)  # graph input

# group: Create CS at Centroid of Roof, Offset and Rotate
byOrigin = CoordinateSystem.ByOrigin(origin=pointAtParameter)

translate = CoordinateSystem.Translate(coordinateSystem=byOrigin, xTranslation=XOffset, yTranslation=YOffset)

# group (continued): Create CS at Centroid of Roof, Offset and Rotate
XAxis = CoordinateSystem.XAxis(coordinateSystem=translate)
YAxis = CoordinateSystem.YAxis(coordinateSystem=translate)
origin = CoordinateSystem.Origin(coordinateSystem=translate)
ZAxis = CoordinateSystem.ZAxis(coordinateSystem=translate)
rotate = CoordinateSystem.Rotate(coordinateSystem=translate, origin=origin, axis=ZAxis, degrees=rotation)  # frozen

# group: Get Plan of Addition by Intersecting Rectangle with Roof
code_block_2 = CodeBlock(x=length, y=width) { [x/2,x/2,-x/2,-x/2]; [y/2,-y/2,-y/2,y/2]; }
byCartesianCoordinates = Point.ByCartesianCoordinates(cs=rotate, x=code_block_2.out0, y=code_block_2.out1)
byPoints = Polygon.ByPoints(points=byCartesianCoordinates)
byPatch = Surface.ByPatch(closedCurve=byPoints)
intersect = Geometry.Intersect(geometry=byPatch, other=roof_surface_2)
# note: For simplicity we only want the largest surface, so sort by area and discard the others
area = Surface.Area(surface=intersect)
sortByKey = List.SortByKey(list=intersect, keys=area)
lastItem = List.LastItem(list=sortByKey.sorted_list)

# group: Thicken Surface to Create Form
code_block_3 = CodeBlock { 0.5; }
normalAtParameter = Surface.NormalAtParameter(surface=lastItem, u=code_block_3, v=code_block_3)
code_block_4 = CodeBlock(v=normalAtParameter) { v.Z < 0; }
boolean = BoolSelector(false)
thicken = Surface.Thicken(surface=lastItem, thickness=height, both_sides=boolean)
# note: If the surface normal is pointing down (and therefore the surface thickens in the wrong direction), translate the solid to bring it into the correct location
translate_2 = Geometry.Translate(geometry=thicken, zTranslation=height)
if_ = If(test=code_block_4, true=translate_2, false=thicken)

# group: Volume - High is Better
volume = Solid.Volume(solid=if_)
volume_2 = Watch(volume)  # graph output

# group: Translate Viewpoints to Chosen Eye Level
eyepoint_above_plane = CodeBlock { 2; }
translate_3 = Geometry.Translate(geometry=viewpoints_2, zTranslation=eyepoint_above_plane)

# group: Viewpoint Selection Limit
# note: Limits the number of viewpoints that are tested to keep computation time down for testing
code_block_5 = CodeBlock(x=translate_3) { x[3..33..2]; x; }

# group: Get Normal for each Face
faces = Topology.Faces(topology=if_)
surfaceGeometry = Face.SurfaceGeometry(face=faces)
code_block_6 = CodeBlock { 0.5; }
normalAtParameter_2 = Surface.NormalAtParameter(surface=surfaceGeometry, u=code_block_6, v=code_block_6)
pointAtParameter_2 = Surface.PointAtParameter(surface=surfaceGeometry, u=code_block_6, v=code_block_6)

# group: Filter out Top and Bottom Surfaces (X component of normal == 0)
X = Vector.X(vector=normalAtParameter_2)
code_block_7 = CodeBlock(x=X) { x==0; }
filterByBoolMask = List.FilterByBoolMask(list=surfaceGeometry, mask=code_block_7)
filterByBoolMask_2 = List.FilterByBoolMask(list=normalAtParameter_2, mask=code_block_7)

filterByBoolMask_3 = List.FilterByBoolMask(list=pointAtParameter_2, mask=code_block_7)

# group (continued): Get Normal for each Face
byTwoPoints = Vector.ByTwoPoints(start=code_block_5.x, end=filterByBoolMask_3.out, lacing=CrossProduct)

# group: Get Surfaces that are Facing the Viewpoint (ignores very acute angles of <10 degrees)
# note: Needs further refinement to avoid surface that are facing to viewer but obscured by other surfaces on the form
code_block_8 = CodeBlock(x=filterByBoolMask.out) { x; }
code_block_9 = CodeBlock(x=code_block_8) { [x]; }
count = List.Count(list=byTwoPoints)
cycle = List.Cycle(list=code_block_9, amount=count)
angleWithVector = Vector.AngleWithVector(vector=filterByBoolMask_2.out, otherVector=byTwoPoints@L2)
# note: Use 100 degrees as the limit to avoid very acute angled surfaces to the viewpoiunt (<10 degrees)
minimum_angle = CodeBlock { 100; }
gt = angleWithVector > minimum_angle
filterByBoolMask_4 = List.FilterByBoolMask(list=cycle, mask=gt)

# note: Requires further work to ensure the number of panels are proportional to the area of the face
number_of_panel_divisions = CodeBlock { 4; }

# group: Lunchbox Panels
panelQuad = Geometry.Panel.PanelQuad(srf=filterByBoolMask_4.in, u=number_of_panel_divisions, v=number_of_panel_divisions)

# group: Explode solids to Surfaces
explode = Geometry.Explode(geometry=buildings_2)
flatten = List.Flatten(list=explode)

# group: Python Calculate Sightlines and Scores
python_script = Python(IN[0]=code_block_5.x, IN[1]=panelQuad.Panels, IN[2]=flatten)
# ---------- python_script.python (71 lines) ----------
# Enable Python support and load DesignScript library
import clr
clr.AddReference('ProtoGeometry')
from Autodesk.DesignScript.Geometry import *

import math

# The inputs to this node will be stored as a list in the IN variables.
points = IN[0]
panels = IN[1]
buildings = IN[2]

lines = []
truncLines = []
truncLinesCol = []
dists = []
buildingsSort = []
keysSort = []
bools = []
scores = []
pansFail = []
pansPass = []

for p1, bPanels in zip(points, panels): # single viewpoint
	#dists.append([])
	dist = []
	bools.append([])
	for b in buildings: # loop through surfaces of buildings and get distance from viewpoint
		dist.append(Geometry.DistanceTo(p1, b))
	dists.append(dist)
	bSort = [x for _,x in sorted(zip(dist,buildings))] # sort by distance from viewpoint
	buildingsSort.append(bSort)
	#dists.append(dist)
	lines.append([])
	truncLines.append([])
	truncLinesCol.append([])
	score = 0
	panPass = 0
	panFail = 0
	for sPanels in bPanels: # side panels in viewpoint
		lines[-1].append([])
		truncLines[-1].append([])
		truncLinesCol[-1].append([])
		bools[-1].append([])
		for pan in sPanels: # for each panel
			p2 = Surface.PointAtParameter(pan, 0.5, 0.5)
			ln = Line.ByStartPointEndPoint(p1,p2)
			lines[-1][-1].append(ln)
			bool = False
			for b in bSort:
				if Geometry.DoesIntersect(b, ln):
					tp = Geometry.Intersect(b, ln)[0]
					truncLines[-1][-1].append(Line.ByStartPointEndPoint(p1,tp))
					truncLinesCol[-1][-1].append(0)
					bool = True
					break
			bools[-1][-1].append(bool)
			if bool:
				panPass += 1
			else:
				panFail += 1
				truncLines[-1][-1].append(ln)
				truncLinesCol[-1][-1].append(1)
	score = float(panPass) / (panPass + panFail) * 100
	scores.append(score)
	pansFail.append(panFail)
	pansPass.append(panPass)
					

# Assign your output to the OUT variable.
OUT = truncLines, bools, scores, pansFail, pansPass, truncLinesCol
# ----------------------------------------
code_block_10 = CodeBlock(x=python_script) { truncLines = x[0]; bools = x[1]; scores = x[2]; pansFail = x[3]; pansPass = x[4]; truncLinesCol = x[5]; }

# group: Mean Score for Form - High is Better
viewpoint_scores = Watch(code_block_10.scores)
mean_score = Math.Average(numbers=viewpoint_scores)
mean_score_2 = Watch(mean_score)  # graph output

# group: Coloured Spheres at Viewpoints
sphere_size = CodeBlock { 5; }
byCenterPointRadius = Sphere.ByCenterPointRadius(centerPoint=code_block_5.x, radius=sphere_size)
color_palette = ColorPalette({R: 255, G: 69, B: 0, A: 255})
color_palette_2 = ColorPalette({R: 127, G: 255, B: 0, A: 255})
code_block_11 = CodeBlock(r=color_palette, g=color_palette_2) { [r,r,g]; }
code_block_12 = CodeBlock { [0,0.75,1]; }
code_block_13 = CodeBlock { 0; 100; 1; }
mapTo = Math.MapTo(rangeMin=code_block_13.out0, rangeMax=code_block_13.out1, inputValue=viewpoint_scores, targetRangeMin=code_block_13.out0, targetRangeMax=code_block_13.out2)
color_range = ColorRange(colors=code_block_11, indices=code_block_12, value=mapTo)
byGeometryColor = Modifiers.GeometryColor.ByGeometryColor(geometry=byCenterPointRadius, color=color_range)

# group: Sightlines as Coloured Lines
code_block_14 = CodeBlock(g=color_palette_2, r=color_palette) { [g,r]; }
code_block_15 = CodeBlock(x=python_script) { x[5]; }
code_block_16 = CodeBlock(c=code_block_14, x=code_block_15) { c[x]; }
byGeometryColor_2 = Modifiers.GeometryColor.ByGeometryColor(geometry=code_block_10.truncLines, color=code_block_16)

# group: Work out min/max dimensions from centre of roof to edges
X_2 = Point.X(point=pointAtParameter)
perimeterCurves = Surface.PerimeterCurves(surface=roof_surface_2)
startPoint = Curve.StartPoint(curve=perimeterCurves)
X_3 = Point.X(point=startPoint)
Y = Point.Y(point=pointAtParameter)
Y_2 = Point.Y(point=startPoint)
code_block_17 = CodeBlock(a=X_2, b=X_3, n=Y, m=Y_2) { a-b; n-m; }
minimumItem = List.MinimumItem(list=code_block_17.out1)
maximumItem = List.MaximumItem(list=code_block_17.out1)
minimumItem_2 = List.MinimumItem(list=code_block_17.out0)
maximumItem_2 = List.MaximumItem(list=code_block_17.out0)

# group: Suggested Min/Max Ranges for XOffset
watch = Watch(minimumItem)
watch_2 = Watch(maximumItem)

# group: Suggested Min/Max Ranges for YOffset
watch_3 = Watch(minimumItem_2)
watch_4 = Watch(maximumItem_2)
